# Dynamo graph CID of Selected Elements.dyn (Dynamo 2.6.2.15705)

selected_elements_in_revit = Python()  # unwired: IN[0]
# ---------- selected_elements_in_revit.python (26 lines) ----------
# Importing required libraries to interact with the Revit API
import clr

# Add a reference to RevitNodes library, which allows interaction with Revit's API using Python
clr.AddReference("RevitNodes")
import Revit  # Import the Revit module from RevitNodes

# Add a reference to RevitServices which includes utilities for interacting with Revit
clr.AddReference("RevitServices")
import RevitServices  # Import RevitServices module
from RevitServices.Persistence import DocumentManager  # Import DocumentManager from RevitServices to provide access to the current Revit document

# Get the current UI document (i.e., the document currently visible in the Revit interface)
uidoc = DocumentManager.Instance.CurrentUIApplication.ActiveUIDocument  

# Get the current database document (i.e., the current open Revit document)
doc = DocumentManager.Instance.CurrentDBDocument

# Retrieve the IDs of the currently selected elements in the Revit interface
selected_element_ids = uidoc.Selection.GetElementIds()

# Fetch the actual Revit elements based on their IDs
selected_elements = [doc.GetElement(id) for id in selected_element_ids]

# Output the selected elements
OUT = selected_elements
# ----------------------------------------
CID = Python(IN[0]=selected_elements_in_revit)
# ---------- CID.python (49 lines) ----------
# Importing required libraries for Dynamo & Revit API
import clr

# Adding references for Revit API
clr.AddReference('RevitAPI')
from Autodesk.Revit.DB import *

# Adding references for DynamoRevit interop
clr.AddReference('RevitNodes')
import Revit
clr.ImportExtensions(Revit.Elements)

def get_item_custom_id(element):
    """Retrieve the ItemCustomId of an element if it exists."""
    if element is None:
        error_messages.append("Error: Passed element is None.")
        return None
    try:
        cid = element.ItemCustomId
        if cid is None:
            error_messages.append("Error for Element {0}: ItemCustomId exists but is None.".format(element.Id))
        return cid
    except AttributeError:
        error_messages.append("Error for Element {0}: Unable to retrieve ItemCustomId".format(element.Id))
        return None


def flatten(input_list):
    """Flatten a list of lists."""
    if isinstance(input_list, list):
        return [a for i in input_list for a in flatten(i)]
    else:
        return [input_list]

error_messages = []  # To collect error messages
cids = []

# Assuming the input elements are provided as IN[0]
unwrapped_elements = [UnwrapElement(element) for element in flatten(IN[0])]

for element in unwrapped_elements:
    cid = get_item_custom_id(element)
    if cid is not None:
        cids.append(cid)

if error_messages:
    OUT = cids, "\n".join(error_messages)
else:
    OUT = cids, "No errors encountered"
# ----------------------------------------
