# Dynamo graph ExcelFileReader.dyn (Dynamo 2.12.1.8246)

python_script = Python()  # IronPython2; unwired: IN[0]
# ---------- python_script.python (49 lines) ----------
import clr
clr.AddReference('System.Windows.Forms')
clr.AddReference('System.Drawing')
clr.AddReferenceByName('Microsoft.Office.Interop.Excel, Version=15.0.0.0, Culture=neutral, PublicKeyToken=71e9bce111e9429c')
from Microsoft.Office.Interop import Excel
from System.Windows.Forms import OpenFileDialog, DialogResult
from System import Environment
from System.Runtime.InteropServices import Marshal

def select_excel_file():
    dialog = OpenFileDialog()
    dialog.Filter = "Excel files (*.xls;*.xlsx)|*.xls;*.xlsx|All files (*.*)|*.*"
    dialog.InitialDirectory = Environment.GetFolderPath(Environment.SpecialFolder.Desktop)
    dialog.Title = "Select an Excel file"

    if dialog.ShowDialog() == DialogResult.OK:
        return dialog.FileName
    else:
        return None

def read_excel(file_path):
    excel_app = Excel.ApplicationClass()
    excel_app.Visible = False
    workbook = excel_app.Workbooks.Open(file_path)
    sheet = workbook.Sheets[1]
    used_range = sheet.UsedRange
    rows = used_range.Rows.Count
    columns = used_range.Columns.Count

    data = [[used_range.Cells(row, col).Value2 for col in range(1, columns + 1)] for row in range(1, rows + 1)]

    workbook.Close(False)
    excel_app.Quit()

    Marshal.ReleaseComObject(sheet)
    Marshal.ReleaseComObject(workbook)
    Marshal.ReleaseComObject(excel_app)

    return data


file_path = select_excel_file()


excel_data = None
if file_path:
    excel_data = read_excel(file_path)

OUT = excel_data
# ----------------------------------------
