# Dynamo graph Statistics.dyn (Dynamo 2.6.2.15705)

# group: Manipulations
# note: "Number of Items effected";
code_block = CodeBlock { "8"; }
end = Revit.Transaction.Transaction.End(input=code_block)

# group: Statistics
script_start_time = Python()
# ---------- script_start_time.python (9 lines) ----------
# Load the Python Standard and DesignScript Libraries
import sys
import clr
clr.AddReference('ProtoGeometry')
from Autodesk.DesignScript.Geometry import *
from datetime import *

# Output the current date and time as a string
OUT = datetime.now().strftime("%Y-%m-%d %H:%M:%S.%f")
# ----------------------------------------
# note: IN[0] is number of elements that are effected.
# The 'scriptid' parameter should reflect the name of the current Dynamo script.
# IMPORTANT: This value needs to be manually updated whenever the Dynamo script filename changes.
statistics_core = Python(IN[0]=code_block, IN[1]=script_start_time, IN[2]=end)
# ---------- statistics_core.python (52 lines) ----------
# clr is a module that provides a bridge between Python and .NET Common Language Runtime (CLR)
import clr
# datetime is a module to work with dates and times.
from datetime import datetime
# System is a .NET library, used here to get the current username
from System import Environment
# Adding reference to Revit's .NET API, necessary for interacting with Revit.
clr.AddReference('RevitAPI')
from Autodesk.Revit.DB import *
# Adding reference to RevitServices, necessary for transactions and accessing the current Revit document.
clr.AddReference('RevitServices')
from RevitServices.Persistence import DocumentManager

# Getting the current document in Revit.
doc = DocumentManager.Instance.CurrentDBDocument

# Getting the title of the current document. Using the Title property from the Revit Document class.
project_title = doc.Title

# 'scriptid' should reflect the name of the current Dynamo script. 
# IMPORTANT: This value needs to be manually updated whenever the Dynamo script filename changes.
scriptid = "Your_Dynamo_Script_Name";

now  = datetime.now()
# Getting the current date.
date = datetime.date(now)
# Getting the current time.
time = datetime.time(now)

# Check if IN[0] is a string. If not, convert it to a string.
action = str(IN[0]) if not isinstance(IN[0], str) else IN[0]
User = Environment.UserName

# Collect input
start  = IN[1]
datain = IN[2]

# Convert start string to datetime
start_datetime = datetime.strptime(start, "%Y-%m-%d %H:%M:%S.%f")

# Output the time now

diff = now - start_datetime
secs = divmod(diff.total_seconds(), 60)
time_in_sec = str(secs[1])
# Outputting a list containing various inputs and variables including the project title, date, and time.
output_list = [scriptid, User, project_title, str(date), str(time), action, time_in_sec]

# Converting all components to string, concatenating them with "|" separator, and ending with a newline character
output_string = "|".join(output_list) + "\n"

OUT = output_string
# ----------------------------------------
write_to_txt = Python(IN[0]=statistics_core)
# ---------- write_to_txt.python (14 lines) ----------
import clr
clr.AddReference('ProtoGeometry')
from Autodesk.DesignScript.Geometry import *

input = IN[0]

# Directly providing the filename along with its absolute path.
filename = r"FilePath\Yourfile_Name.txt"

with open(filename, 'a') as file:
    # Writing the input into the file.
    file.write(input)

OUT = "success"
# ----------------------------------------

# group: Final dialogue
ui_successfull_massage = Python(IN[0]=code_block, IN[1]=end)
# ---------- ui_successfull_massage.python (14 lines) ----------
import clr
clr.AddReference("RevitAPIUI")
from Autodesk.Revit.UI import *
#IN[0] is the numer of ellements effected
action = str(IN[0]) if not isinstance(IN[0], str) else IN[0]
title = "Great Success"
body  = "Items Changed: " + action
passt = IN[1]

msg = TaskDialog.Show(title, body,
TaskDialogCommonButtons.Ok)

if msg == TaskDialogResult.Ok:
	OUT = passt
# ----------------------------------------
